# Grasshopper definition simple.gh (Grasshopper 1.0.7)

python = GhPythonScript()  # -> out, file
# ---------- python: Python ----------
import rhinoscriptsyntax as rs

filter = "GCode (*.gcode)|*.gcode|All Files (*.*)|*.*||"
file = rs.SaveFileName("", filter)
# ---------- end python ----------
python_2 = GhPythonScript(file=python.file, density=Slider(0.2, range=0..1))  # -> out, lines, extrusion, point
# ---------- python_2: Python ----------
# code required so that library reloads appropriately
# must be above other import statements
import sys
to_delete = list()
for module in sys.modules:
   if "extruder_turtle" in module:
      to_delete.append(module)  

for module in to_delete:
    sys.modules.pop(module)
    
import rhinoscriptsyntax as rs
import numbers
import extruder_turtle
from extruder_turtle import *
import math

reload(extruder_turtle)


## Set up the turtle
t = ExtruderTurtle()
t.track_history = True
t.use_degrees = True
t.name(file)
t.setup(x=0, y=0, z=.2)

for layer in range (10):
    for i in range(360):
        t.forward(1)
        t.right(1)
    t.lift(1.5)
    

#######################################
#######################################
#######################################
#######################################
lines = []
for l in t.line_segs:
    lines.append(rs.AddLine(l[0], l[1]))

extrusion = []
i = 0
for e in t.extrusion_history:
    if (i>0):
        distance = rs.CurveLength(lines[i])
        density = e/distance
        if (density == 0):
            density = (t.extrusion_history[i-1])/rs.CurveLength(lines[i-1])
        extrusion.append(density)
    i=i+1

t.finish()
# ---------- end python_2 ----------
line = Line(python_2.lines)
pipe = Pipe(Curve=line, Radius=python_2.extrusion, Caps=0)
pt = Point(python_2.point)
sph = Sphere(Base=pt, Radius=Slider(2.9, range=0..20))
