# Grasshopper definition simple_example.gh (Grasshopper 1.0.7)

python = GhPythonScript()  # -> out, file
# ---------- python: Python ----------
import rhinoscriptsyntax as rs

filter = "GCode (*.gcode)|*.gcode|All Files (*.*)|*.*||"
file = rs.SaveFileName("", filter)
# ---------- end python ----------
python_2 = GhPythonScript(file=python.file)  # -> out, lines, extrusion, turtle
# ---------- python_2: Python ----------
# code required so that library reloads appropriately
# must be above other import statements
import sys
to_delete = list()
for module in sys.modules:
   if "extruder_turtle" in module:
      to_delete.append(module)  

for module in to_delete:
    sys.modules.pop(module)
    
import rhinoscriptsyntax as rs
import numbers
import extruder_turtle
from extruder_turtle import *
import math
import random

reload(extruder_turtle)

#potter bot parameters
layer_height = 3
extrude_rate = 3

t = ExtruderTurtle()
t.use_degrees = True

## Set up the turtle
t.setup(x=10, y=10, z=0, filename=file)
t.set_density(extrude_rate)

for i in range (10):
    for j in range (6):
        t.forward(100)
        t.right(360/6)
    t.lift(layer_height)
    
turtle = t.draw_turtle()

#####################################################


lines = []
for l in t.line_segs:
    lines.append(rs.AddLine(l[0], l[1]))

extrusion = []
i = 0
for e in t.extrusion_history:
    if (i>0):
        distance = rs.CurveLength(lines[i])
        density = e/distance
        extrusion.append(.2)
    i=i+1

t.finish()
# ---------- end python_2 ----------
line = Line(python_2.lines)
srf = Surface(python_2.turtle)
pipe = Pipe(Curve=line, Radius=python_2.extrusion, Caps=0)
