# Grasshopper definition solids.gh (Grasshopper 1.0.7)

python = GhPythonScript()  # -> out, file
# ---------- python: Python ----------
import rhinoscriptsyntax as rs

filter = "GCode (*.gcode)|*.gcode|All Files (*.*)|*.*||"
file = rs.SaveFileName("", filter)
# ---------- end python ----------
python_2 = GhPythonScript(file=python.file)  # -> out, lines, extrusion, turtle
# ---------- python_2: Python ----------
# code required so that library reloads appropriately
# must be above other import statements
import sys
to_delete = list()
for module in sys.modules:
   if "extruder_turtle" in module:
      to_delete.append(module)  

for module in to_delete:
    sys.modules.pop(module)
    
import rhinoscriptsyntax as rs
import numbers
import extruder_turtle
from extruder_turtle import *
import math
import random

reload(extruder_turtle)

t = ExtruderTurtle()
t.use_degrees = True

## Set up the turtle
t.setup(x=100, y=100, z=0, filename=file)

extrude_width = .5
extrude_height = .2
layer_height = .2

def polygon_prism (size, number_sides, height):
    for i in range(int(height/layer_height)):
        for j in range(number_sides):
            t.forward(size)
            t.right(360/number_sides)
        t.lift(layer_height)

def bump(size):        
    t.left(90)
    t.forward(size)
    t.right(90)
    t.forward(size)
    t.right(90)
    t.forward(size)
    t.left(90)
        
def bumpy_polygon_prism (size, number_sides, height):
    for i in range(int(height/layer_height)):
        for j in range(number_sides):
            x = random.randint(1,size-3)
            t.forward(x)
            # create 2mm bump
            bump(2)
            t.forward(size-x-2)
            t.right(360/number_sides)
        t.lift(layer_height)

def square(size):
    for i in range(int(size/2/extrude_width)):
        t.forward(size)
        t.right(90)
        t.forward(extrude_width)
        t.right(90)
        t.forward(size)
        t.left(90)
        t.forward(extrude_width)
        t.left(90)
    t.right(90)
    t.backward(size)
    t.left(90)
    
def rectangle(side1, side2):
    for i in range(int(side2/2/extrude_width)):
        t.forward(side1)
        t.right(90)
        t.forward(extrude_width)
        t.right(90)
        t.forward(side1)
        t.left(90)
        t.forward(extrude_width)
        t.left(90)
    t.right(90)
    t.backward(side2)
    t.left(90)
    
def cube(size):
    for i in range(int(size/layer_height)):
        square(size)
        t.forward(size)
        t.right(90)
        t.lift(layer_height)
        
def rectangular_prism(side1, side2, height):
    for i in range(int(height/layer_height)):
        rectangle(side1, side2)
        t.lift(layer_height)
    
 
def polygon(size, number_sides):
    r = size/(2*math.sin(math.radians(180/number_sides)))
    outer_angle = 360/number_sides
    inner_angle = 180-360/number_sides
    t.penup()
    t.forward(r)
    t.left(outer_angle + inner_angle/2)
    t.pendown()
    for j in range(number_sides):
        t.forward(size)
        t.left(outer_angle)
    t.penup()
    t.right(outer_angle + inner_angle/2)
    t.backward(r)
    t.pendown()

def polygon_layer (size, number_sides):
    if (size < extrude_width):
        return
    polygon(size,number_sides)
    polygon_layer(size-extrude_width*2, number_sides)
        
'''
t.use_degrees = False
DIAMETER = 40
N = 80
dtheta = 2*math.pi/N
dx = DIAMETER*math.sin(dtheta/2)

for l in range(50):
    for h in range(N):
        t.right(dtheta)
        t.forward(dx)
        t.left(math.pi/2)
        t.forward(1)
        t.dwell(50)
        t.forward(-2)
        t.dwell(50)
        t.forward(1)
        t.right(math.pi/2)
    t.lift(0.3)
'''

'''
diameter = 40
circumference = math.pi*diameter
steps = 80
dtheta = 360/steps
dx = circumference/steps

for layers in range(50):
    for s in range(steps):
        t.right(dtheta)
        t.forward(dx)
        t.left(90)
        t.forward(1)
        t.dwell(50)
        t.backward(2)
        t.dwell(50)
        t.forward(1)
        t.right(90)
    t.lift(.2)
'''

'''
X = 25
a = .3/X
h = .3
v = 1


density = .04
rate = 200
t.lift(-.1)
t.rate(rate)
t.set_density(density)

for layers in range(6):    
    v = (layers+45)/30
    for side in range(7):
        if (layers < 3):
            t.extrude(2)
            t.lift(-.1)
            t.extrude(-1)
            t.dwell(100)
            t.lift(.1)
            t.extrude(-1)
        for x in range(-X, X+1):
            a = v*h/X
            t.forward_lift(1, -x*a)
        t.right(360*4/7)
        t.lift(.2/21)
    if (density < .06):
        density = density + .01
        t.set_density(density)
    if (rate < 1000):
        rate = rate + 200
        t.rate(rate)
'''


size = 50
dy = 5
dx = 5

t.set_density(.05)
t.rate(1000)
for i in range (5):
    t.forward(size)
    t.left(90)
    t.forward(size)
    t.lift(.2)
    t.backward(size)
    t.right(90)
    t.backward(size)
    t.lift(.2)

startingX = t.getX()
startingY = t.getY()

t.rate(300)
#t.set_density(.2)
for i in range(int(size/(dx*2))):
    previousX = t.getX()
    previousY = t.getY()
    nextX = startingX + size
    nextY = startingY + dy*(i*2+1)
    t.set_position(nextX, nextY)
    t.left(90)
    t.forward(dy)
    t.dwell(1000)
    t.lift(.01)
    t.set_position(previousX+dx, previousY)
    t.right(90)
    t.forward(dx)
    t.lift(.01)

t.penup()
t.backward(size)
t.pendown()

t.set_density(.05)
t.rate(1000)
for i in range (2):
    t.forward(size)
    t.left(90)
    t.forward(size)
    t.lift(.2)
    t.backward(size)
    t.right(90)
    t.backward(size)
    t.lift(.2)
    
turtle = t.draw_turtle()


t.penup()
t.backward(size)
t.pendown()




'''
t.use_degrees = False
dtheta = math.pi*2/100
a = 30
n = 3
steps = 100

for s in range(steps):
    angle = s*dtheta
    t.forward_lift(1,a*math.sin(n*angle)/100)
    t.right(dtheta)
'''

#turtle = t.draw_turtle()

#bumpy_polygon_prism(20,7,50)
'''
hair_length = 50
cube(10)        # build first support
# mover to second support position
t.penup()       
t.forward(hair_length)  
t.lift(-10)
t.pendown()
cube(10)        # build second support
extrude_width *= 2   #decrease fill density for hairs
rectangle(hair_length,10)   # build hair

#turtle = t.draw_turtle()
'''


#####################################################


lines = []
for l in t.line_segs:
    lines.append(rs.AddLine(l[0], l[1]))

extrusion = []
i = 0
for e in t.extrusion_history:
    if (i>0):
        distance = rs.CurveLength(lines[i])
        density = e/distance
        extrusion.append(extrude_width)
    i=i+1

t.finish()
# ---------- end python_2 ----------
line = Line(python_2.lines)
srf = Surface(python_2.turtle)
pipe = Pipe(Curve=line, Radius=python_2.extrusion, Caps=0)
