# Grasshopper definition turtletest.gh (Grasshopper 1.0.7)

python = GhPythonScript()  # -> out, file
# ---------- python: Python ----------
import rhinoscriptsyntax as rs

filter = "GCode (*.gcode)|*.gcode|All Files (*.*)|*.*||"
file = rs.SaveFileName("", filter)
# ---------- end python ----------
python_2 = GhPythonScript(file=python.file, density=Slider(0.2, range=0..1))  # -> out, lines, extrusion
# ---------- python_2: Python ----------
# code required so that library reloads appropriately
# must be above other import statements
import sys
to_delete = list()
for module in sys.modules:
   if "extruder_turtle" in module:
      to_delete.append(module)  

for module in to_delete:
    sys.modules.pop(module)
    
import rhinoscriptsyntax as rs
import numbers
import extruder_turtle
from extruder_turtle import *
import math

reload(extruder_turtle)

# reload(extruder_turtle)

t = ExtruderTurtle()
t.track_history = True
t.use_degrees = True

## Set up the turtle
t.name(file)
t.setup(x=50, y=100)
t.rate(1000)
t.lift(.5)

for i in range(10):
    t.set_density(.05+.02*(i+1))
    t.pendown()
    t.forward(150)
    t.penup()
    t.extrude(-2)
    t.lift(30)
    t.dwell(5000)
    t.forward(-150)
    t.lift(-30)
    t.right(90)
    t.forward(3)
    t.left(90)
    t.lift(.05)

lines = []
for l in t.line_segs:
    lines.append(rs.AddLine(l[0], l[1]))

extrusion = []
i = 0
for e in t.extrusion_history:
    if (i>0):
        distance = rs.CurveLength(lines[i])
        density = e/distance
        extrusion.append(density/2)
    i=i+1

t.finish()
# ---------- end python_2 ----------
line = Line(python_2.lines)
pipe = Pipe(Curve=line, Radius=python_2.extrusion, Caps=0)
