# Grasshopper definition turtletest.gh (Grasshopper 1.0.7)

python = GhPythonScript()  # -> out, lines
# ---------- python: Python ----------
__author__ = "franklindyer"

import rhinoscriptsyntax as rs
import sys
import numbers
from extruder_turtle import ExtruderTurtle
import math

t = ExtruderTurtle()
t.track_history = True

## Set up the turtle
t.name("seven-star.gcode")
t.setup(x=100, y=100)
t.rate(700)

for l in range(30):
    ## Draw a seven-pointed star
    for k in range(7):
        t.move(50)
        t.right(6*math.pi/7)

    ## Move to the next layer
    t.lift(0.3)

lines = []
for l in t.line_segs:
    lines.append(rs.AddLine(l[0], l[1]))
print(t.line_segs)
# ---------- end python ----------
line = Line(python.lines)
